# Grasshopper definition ML_Training_data_generator.ghx (Grasshopper 1.0.7)
# plug-ins: Human

tykkelse_vegg = Slider(0.3, range=0..1)
profondeur_de_la_boite = Slider(8, range=0..10)
rammeandel = Slider(0.2, range=0..1)

# ---- group: Grid
distance_floor = Slider(0.8, range=0..1)
grid_size = Slider(0.5, range=0..1)
offset = Slider(0.5, range=0..1)

# ----
hauteur_de_la_boite = Slider(3, range=0..10)
largeur_de_la_boite = Slider(10, range=0..100)

panel = Panel("https://www.energyplus.net/weather-download/europe_wmo_region_6/NOR//NOR_Oslo.Fornebu.014880_IWEC/all")
downloadepw = LBDownloadWeather(weather_URL=panel)  # -> epw_file, stat_file, ddy_file; plug-in component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

number_slider = Slider(0.3, range=0.1..0.9)
rotate = Slider(0, range=0..7)
number_slider_2 = Slider(0.7, range=0..1)

# ----
# www.ntnu.no
# Daylight
# Developed by TK
# v1.00 - 01.2021
# Oppstart
# Generere layers
toggle = BooleanToggle(True)
python_script = PythonScript(x=toggle)  # -> out
# ---------- python_script: Python ----------
import Rhino
import rhinoscriptsyntax as rs
import scriptcontext as sc

sc.doc = Rhino.RhinoDoc.ActiveDoc

if True:
    rs.AddLayer("Zone")
    rs.AddLayer("Skygge")
# ---------- end python_script ----------

# ---- group: Annual
# Set at 1 for testing
boolean_toggle = BooleanToggle(False)
panel_2 = Panel("-ab 1")

# ---- group: DF
# Set at 1 for testing
boolean_toggle_2 = BooleanToggle(False)
panel_3 = Panel("-ab 1")

# ----
dynamic_geometry_pipeline = DynamicGeometryPipeline(
    LayerFilter="Int_Geo",
    TypeFilter="all",
    NameFilter="*",
    GroupByLayer=False,
    GroupByType=False,
    IncludeHidden=True,
    IncludeLocked=True,
    enableFullPath=False,
    listenToAttributes=True)

dynamic_geometry_pipeline_2 = DynamicGeometryPipeline(
    LayerFilter="Ex_Geo",
    TypeFilter="all",
    NameFilter="*",
    GroupByLayer=False,
    GroupByType=False,
    IncludeHidden=True,
    IncludeLocked=True,
    enableFullPath=False,
    listenToAttributes=True)

# ----
# Windows
dynamic_geometry_pipeline_3 = DynamicGeometryPipeline(
    LayerFilter="Context",
    TypeFilter="all",
    NameFilter="*",
    GroupByLayer=False,
    GroupByType=False,
    IncludeHidden=True,
    IncludeLocked=True,
    enableFullPath=False,
    listenToAttributes=True)

# ----
# Windows
dynamic_geometry_pipeline_4 = DynamicGeometryPipeline(
    LayerFilter="Windows",
    TypeFilter="all",
    NameFilter="*",
    GroupByLayer=False,
    GroupByType=False,
    IncludeHidden=True,
    IncludeLocked=True,
    enableFullPath=False,
    listenToAttributes=True)

# ----
# Zone
dynamic_geometry_pipeline_5 = DynamicGeometryPipeline(
    LayerFilter="Zone",
    TypeFilter="all",
    NameFilter="*",
    GroupByLayer=False,
    GroupByType=False,
    IncludeHidden=True,
    IncludeLocked=True,
    enableFullPath=False,
    listenToAttributes=True)

rectangle = Rectangle(Plane=PlaneXY(0, 0, 0), XSize=largeur_de_la_boite, YSize=profondeur_de_la_boite, Radius=0)  # -> Rectangle, Length
boxrec = BoxRectangle(Rectangle=rectangle.Rectangle, Height=hauteur_de_la_boite)

ex = Brep(dynamic_geometry_pipeline_2)
int = Brep(dynamic_geometry_pipeline)
face = HBFace(geo=int, bc="Adiabatic")  # -> out, faces; plug-in component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
face_2 = HBFace(geo=ex, bc="Outdoors")  # -> out, faces; plug-in component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

fly = Ladybug_fly(inputSliders=[rotate, number_slider, number_slider_2], fly=Toggle(False))  # -> Vviiiiiiiiiizzz; inputs inputSliders: list, fly: Boolean; plug-in component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

hb_building_vintages = HBBuildingVintages({"ASHRAE 90.1 2013  |  IECC 2015": "2013", "ASHRAE 90.1 2010  |  IECC 2012": "2010", "ASHRAE 90.1 2007  |  IECC 2009": "2007", "ASHRAE 90.1 2004  |  IECC 2006": "2004", "1980-2004 (CBECS)": "1980_2004", "Pre-1980 (CBECS)": "pre_1980"}, selected="ASHRAE 90.1 2013  |  IECC 2015")
hb_climate_zones = HBClimateZones({"1 - Very Hot": "1", "2 - Hot": "2", "3 - Warm": "3", "4 - Mixed": "4", "5 - Cool": "5", "6 - Cold": "6", "7 - Very Cold": "7", "8 - Subarctic": "8"}, selected="6 - Cold")
hb_construction_types = HBConstructionTypes({"SteelFramed", "WoodFramed", "Mass", "Metal Building"}, selected="WoodFramed")
subfacesubset = HBSubfaceSubset()  # -> subface_set; plug-in component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
constrsetclimate = HBConstructionSetByClimate(climate_zone=hb_climate_zones, vintage=hb_building_vintages, constr_type=hb_construction_types)  # -> constr_set; plug-in component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
constructionset = HBConstructionSet(name="Nordisk_Klima", base_constr_set=constrsetclimate, subface_subset=subfacesubset)  # -> constr_set; plug-in component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

# ---- group: Valg av sone
hb_building_programs = HBBuildingPrograms({"LargeOffice", "MediumOffice", "SmallOffice", "MidriseApartment", "HighriseApartment", "Retail", "StripMall", "PrimarySchool", "SecondarySchool", "SmallHotel", "LargeHotel", "Hospital", "Outpatient", "Laboratory", "Warehouse", "SuperMarket", "FullServiceRestaurant", "QuickServiceRestaurant", "Courthouse", "LargeDataCenterHighITE", "LargeDataCenterLowITE", "SmallDataCenterHighITE", "SmallDataCenterLowITE"}, selected="SmallOffice")
searchprog = HBSearchPrograms(bldg_prog=hb_building_programs, keywords="closed")  # -> room_prog; plug-in component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
room = HBRoom(
    faces=flatten([face.faces, face_2.faces]),
    name="TEST_Soner",
    constr_set=constructionset,
    program=searchprog,
    conditioned=Toggle(False))  # -> out, room; plug-in component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
solveadj = HBSolveAdjacency(rooms=flatten(room.room), run=Toggle(True))  # -> out, adj_rooms; plug-in component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

# ----
# Annotation
# Bake
# Design
# Monitor
# <Annotation> For komentarer og prosjektinformasjon
# <Bake> For noder som baker geometri og parametre til Rhino
# <Monitor> Viktige noder som bør overvåkes
# Input
# Visibility
# Controll
# <Visibility> for å visualisere geometri og farge i Rhino
# <Input> For faste input (eks. filstier)
# <Controll> For variabler (eks. Sliders)
panel_4 = Panel("<design> For generelle noder")

multiplication = Multiplication(A=rotate, B=45)
rotate_2 = HBRotate(hb_objs=flatten(solveadj.adj_rooms), angle=multiplication)  # -> hb_objs; plug-in component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

facesbytype = HBFacesByType(hb_objs=rotate_2)  # -> walls, interior_walls, roofs, ceilings, exterior_floors, interior_floors, air_walls, apertures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; plug-in component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
vizquick = HBVizualizeQuick(hb_objs=flatten(facesbytype.walls))  # -> geo; plug-in component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
# WIP
# <WIP> For uferdig noder som mangler SK
list_item = ListItem(List=vizquick, Index=0, Wrap=True)
area = Area(Geometry=list_item)  # -> Area, Centroid
square_root = SquareRoot(Value=number_slider)
scale = Scale(Geometry=list_item, Center=area.Centroid, Factor=square_root)  # -> Geometry, Transform
aperture = HBAperture(geo=scale.Geometry)  # -> out, apertures; plug-in component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
addsubface = HBAddSubface(hb_obj=flatten(rotate_2), sub_faces=flatten(aperture.apertures))  # -> hb_obj; plug-in component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
bordershades = HBExtrudedBorderShades(hb_objs=flatten(addsubface), depth=tykkelse_vegg)  # -> out, hb_objs; plug-in component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

# ----
# Rammeandel inn
panel_5 = Panel("1")
subtraction = Subtraction(A=panel_5, B=rammeandel)

# ----
# Vindusgeometri inn
brep = Brep(<brep referenced from the Rhino model>)

# ----
# Rammeandel
area_2 = Area(Geometry=brep)  # -> Area, Centroid
square_root_2 = SquareRoot(Value=subtraction)

# ----
# Kutting
scale_2 = Scale(Geometry=brep, Center=area_2.Centroid, Factor=square_root_2)  # -> Geometry, Transform
solid_difference = SolidDifference(BrepsA=brep, BrepsB=scale_2.Geometry)

# ----
# Geometri ut
karm = Brep(solid_difference)
vindu = Brep(scale_2.Geometry)

# ----
# Kontrollberegning
area_3 = Area(Geometry=brep)  # -> Area, Centroid
area_4 = Area(Geometry=karm)  # -> Area, Centroid
division = Division(A=area_4.Area, B=area_3.Area)
rammeandel_kontrloll = Panel(division)

# ---- group: Refleksjon
number_slider_3 = Slider(0, range=0..100)
number_slider_4 = Slider(0.2, range=0..1)
number_slider_5 = Slider(0, range=0..100)
number_slider_6 = Slider(0, range=0..100)
number_slider_7 = Slider(0, range=0..100)
number_slider_8 = Slider(0.5, range=0..1)
number_slider_9 = Slider(0.2, range=0..1)
number_slider_10 = Slider(0.7, range=0..1)
panel_6 = Panel("Karm")
panel_7 = Panel("Gulv")
panel_8 = Panel("Himling")
panel_9 = Panel("Vinduglass")
panel_10 = Panel("Vegg")

# ---- group: Refleksjon Skygge
number_slider_11 = Slider(0, range=0..100)
number_slider_12 = Slider(0.2, range=0..1)
panel_11 = Panel("Skygge")

# ---- group: Refleksjon
glassmod = HBGlassModifier(name=panel_9, trans=number_slider_2)  # -> modifier; plug-in component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
opaquemod = HBOpaqueModifier(name=panel_7, reflect=number_slider_9, spec=number_slider_6, rough=number_slider_6)  # -> modifier; plug-in component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
opaquemod_2 = HBOpaqueModifier(name=panel_10, reflect=number_slider_8, spec=number_slider_5, rough=number_slider_5)  # -> modifier; plug-in component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
opaquemod_3 = HBOpaqueModifier(name=panel_8, reflect=number_slider_10, spec=number_slider_7, rough=number_slider_7)  # -> modifier; plug-in component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
opaquemod_4 = HBOpaqueModifier(name=panel_6, reflect=number_slider_4, spec=number_slider_3, rough=number_slider_3)  # -> modifier; plug-in component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
subfacesubset_2 = HBSubfaceModifierSubset(window=glassmod, skylight=glassmod, operable=glassmod)  # -> subface_set; plug-in component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
interiorsubset = HBInteriorModifierSubset(interior_wall=opaquemod_2, ceiling=opaquemod_3, interior_floor=opaquemod)  # -> interior_set; plug-in component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
exteriorsubset = HBExteriorModifierSubset(exterior_wall=opaquemod_2, exterior_roof=opaquemod_3, exposed_floor=opaquemod)  # -> exterior_set; plug-in component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
shadesubset = HBShadeModifierSubset(exterior_shade=opaquemod_4)  # -> shade_set; plug-in component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
modifierset = HBModifierSet(
    name="mod_TP2",
    exterior_subset=exteriorsubset,
    interior_subset=interiorsubset,
    subface_subset=subfacesubset_2,
    shade_subset=shadesubset)  # -> mod_set; plug-in component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
applymodset = HBApplyModifierSet(rooms=bordershades.hb_objs, mod_set=modifierset)  # -> rooms; plug-in component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

# ---- group: Refleksjon Skygge
opaquemod_5 = HBOpaqueModifier(name=panel_11, reflect=number_slider_12, spec=number_slider_11, rough=number_slider_11)  # -> modifier; plug-in component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
glassmod_2 = HBGlassModifier(name="Vinduglass", trans=Slider(0.7, range=0..1))  # -> modifier; plug-in component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
data = Data(glassmod)
subfacesubset_3 = HBSubfaceModifierSubset(window=data, skylight=data, operable=data)  # -> subface_set; plug-in component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
exteriorsubset_2 = HBExteriorModifierSubset(exterior_wall=opaquemod_5, exterior_roof=opaquemod_5, exposed_floor=opaquemod_5)  # -> exterior_set; plug-in component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
interiorsubset_2 = HBInteriorModifierSubset(
    interior_wall=opaquemod_5,
    ceiling=opaquemod_5,
    interior_floor=opaquemod_5,
    interior_window=opaquemod_5,
    interior_door=opaquemod_5,
    int_glass_door=opaquemod_5)  # -> interior_set; plug-in component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
modifierset_2 = HBModifierSet(exterior_subset=exteriorsubset_2, interior_subset=interiorsubset_2, subface_subset=subfacesubset_3)  # -> mod_set; plug-in component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

# ----
number_slider_13 = Slider(0.5, range=0..1)

facesbytype_2 = HBFacesByType(hb_objs=applymodset)  # -> walls, interior_walls, roofs, ceilings, exterior_floors, interior_floors, air_walls, apertures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; plug-in component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
vizall = HBVizualizeAll(hb_objs=flatten([facesbytype_2.exterior_floors, facesbytype_2.interior_floors]))  # -> geo; plug-in component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
negative = Negative(Value=distance_floor)
grid = Grid(gulv=vizall, offset=number_slider_13, grid_size=number_slider_13, distance_floor=distance_floor)  # -> point_2, mesh_2, normals_2
mesh_join = MeshJoin(Meshes=flatten(grid.mesh_2))
data_2 = Data(flatten(grid.point_2))
clean_tree = CleanTree(RemoveNulls=True, RemoveInvalid=True, RemoveEmpty=False, Tree=applymodset)
sensorgrid = HBSensorGrid(name="grid_BYGG1", positions=data_2, mesh=mesh_join)  # -> grid; plug-in component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

number_slider_14 = Slider(1, range=0..10)
number_slider_15 = Slider(0.5, range=0..1)
genpts = LBGeneratePointGrid(geometry=grid.mesh_2, grid_size=grid_size, offset_dist=negative)  # -> points, vectors, face_areas, graft(mesh); plug-in component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

# ---- group: Sammenstille
model = HBModel(rooms=flatten(clean_tree), name="TP2_Test_MS")  # -> report, model; plug-in component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
assigngridsviews = HBAssignGridsAndViews(model=model.model, grids=flatten(sensorgrid))  # -> model; plug-in component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

# ----
vizbytype = HBVisualizeByType(hb_objs=model.model)  # -> walls, interior_walls, roofs, ceilings, exterior_floors, interior_floors, air_walls, apertures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; plug-in component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

# ---- group: Schedule
panel_12 = Panel("""0
0
0
0
0
0
0
1
1
1
1
1
1
1
1
1
0
0
0
0
0
0
0
0""")
constantschedule = HBConstantSchedule(values=panel_12, name="Arbeids_dag")  # -> out, schedule, idf_text; plug-in component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
schtodata = HBScheduleToData(schedule=constantschedule.schedule)  # -> data; plug-in component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

# ----
hb_face_radiance_attributes = HBFaceRadianceAttributes({"Modifier": "properties.radiance.modifier.display_name", "Modifier Blk": "properties.radiance.modifier_blk.display_name", "Is Opaque": "properties.radiance.is_opaque", "Dynamic Group": "properties.radiance.dynamic_group_identifier", "State Count": "properties.radiance.state_count", "States": "properties.radiance.states"}, selected="Modifier")
vizall_2 = HBVizualizeAll(hb_objs=flatten(applymodset))  # -> geo; plug-in component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
brep_wireframe = BrepWireframe(Brep=vizall_2, Density=-1)

importepw = LBImportEPW(epw_file=downloadepw.epw_file)  # -> location, dry_bulb_temperature, dew_point_temperature, relative_humidity, wind_speed, wind_direction, direct_normal_rad, diffuse_horizontal_rad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; plug-in component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
wea = HBWeaFromEPW(epw_file=downloadepw.epw_file)  # -> wea; plug-in component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
xdata = LBDeconstructData(data=importepw.global_horizontal_ill)  # -> header, values; plug-in component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

vizbytype_2 = HBVisualizeByType(hb_objs=model.model)  # -> walls, interior_walls, roofs, ceilings, exterior_floors, interior_floors, air_walls, apertures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; plug-in component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
lablefaces = HBLabelFaces(hb_objs=flatten(model.model), attribute=hb_face_radiance_attributes, sub_faces=Toggle(False))  # -> label_text, base_pts, labels, wire_frame; plug-in component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
colorfaceattr = HBColorFaceAttributes(hb_objs=flatten(model.model), attribute=hb_face_radiance_attributes)  # -> mesh, legend, wire_frame, values, colors; plug-in component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
custom_preview = CustomPreview(Material=ColourSwatch(SwatchColor=RGB(161, 161, 161)))
# Simulation
# Model
custom_preview_2 = CustomPreview(Geometry=brep_wireframe, Material=ColourSwatch(SwatchColor=RGB(0, 0, 0)))

list_length = ListLength(List=grid.point_2)
boolean_toggle_3 = BooleanToggle(True)
division_2 = Division(A=list_length, B="8")
recipesettings = HBRecipeSettings(folder="C:\Users\tobia\Documents\Rhino\Test", workers="8", reload_old=boolean_toggle_3, report_out=boolean_toggle_3)  # -> settings; plug-in component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
round = Round(Number=division_2)  # -> Nearest, Floor, Ceiling
# Post-prosess
annualdaylight = HBAnnualDaylight(
    model=assigngridsviews,
    wea=wea,
    schedule=schtodata,
    sensor_count=round.Ceiling,
    radiance_par=panel_3,
    run_settings=recipesettings,
    run=boolean_toggle)  # -> report, results, DA, cDA, UDI, UDI_low, UDI_up; plug-in component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

sun_up = Sun_up(lux_values=xdata.values)
fixedintervalschedule = HBFixedIntervalSchedule(values=sun_up, name="NS_SUN_up")  # -> out, schedule; plug-in component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
schtodata_2 = HBScheduleToData(schedule=fixedintervalschedule.schedule)  # -> data; plug-in component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

facesbytype_3 = HBFacesByType(hb_objs=model.model)  # -> walls, interior_walls, roofs, ceilings, exterior_floors, interior_floors, air_walls, apertures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; plug-in component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
vizquick_2 = HBVizualizeQuick(hb_objs=flatten(facesbytype_3.apertures))  # -> geo; plug-in component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

mesh_custom = Data(genpts.mesh)
mesh = Data(grid.mesh_2)
data_3 = Data(annualdaylight.results)
orgin_pt_list = Data(grid.point_2)

# ---- group: Generate results / exctract results
# Results
explode_tree = ExplodeTree(Data=graft(data_3))  # -> _0000, Branch1
read_file = ReadFile(File=explode_tree._0000, PerLineParse=True)
read_file_2 = ReadFile(File=explode_tree.Branch1, PerLineParse=True)
ghpython_script = GhPythonScript(x=read_file)  # -> a
# ---------- ghpython_script: Python ----------
a = x.split()
# ---------- end ghpython_script ----------
number = Number(ghpython_script)

# ---- group: Generate results / Generate 8760 data
duplicate_data = DuplicateData(Data=Slider(0, range=0..100), Number=Slider(8760, range=0..10000), Order=True)
integer = Integer(read_file_2)
replace_items = ReplaceItems(List=duplicate_data, Item=number, Indices=integer, Wrap=False)

# ---- group: Distance / Project window to plane
window = Data(vizquick_2)
pt = Data(grid.point_2)
deconstruct_brep = DeconstructBrep(Brep=window)  # -> Faces, Edges, Vertices
frame = Data(deconstruct_brep.Edges)
curve_middle = CurveMiddle(Curve=frame)
deconstruct = Deconstruct(Point=curve_middle)  # -> XComponent, YComponent, ZComponent
sort_list = SortList(Keys=deconstruct.ZComponent, ValuesValuesA=frame)  # -> Keys, ValuesValuesA
list_item_2 = ListItem(List=pt, Index=0, Wrap=True)
list_item_3 = ListItem(List=sort_list.ValuesValuesA, Index=0, Wrap=True)  # -> Item, Item1, Item2, Item3
construct_plane = ConstructPlane(Origin=list_item_2, XAxis=Vector(1, 0, 0), YAxis=Vector(0, 1, 0))
project = Project(Geometry=list_item_3.Item, Plane=construct_plane)  # -> Geometry, Transform

# ---- group: Results
panel_13 = Panel("""300
2000""")
annualmetrics = HBAnnualDaylightMetrics(results=data_3, occ_sch=schtodata_2, threshold="300", min_max=panel_13)  # -> out, DA, UDI; plug-in component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
ghpython_script_2 = GhPythonScript(x=annualmetrics.DA)  # -> a
# ---------- ghpython_script_2: Python ----------
__author__ = "tobia"
__version__ = "2021.02.05"

import rhinoscriptsyntax as rs

a = round(float(x),0)
# ---------- end ghpython_script_2 ----------

# ---- group: Dele opp data
resultater = Data(ghpython_script_2)
list_length_2 = ListLength(List=orgin_pt_list)
partition_list = PartitionList(List=resultater, Size=flatten(list_length_2))

# ---- group: Vizual
colrange = LBColorRange(index=Slider(1, range=0..25))  # -> colors; plug-in component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
legendpar = LBLegendParameters(min=Slider(0, range=0..100), max=Slider(100, range=0..100), colors=colrange)  # -> leg_par; plug-in component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
heatmap = LBSpatialHeatmap(values=partition_list, mesh=mesh, legend_par=legendpar)  # -> mesh, legend, title, colors, legend_par; plug-in component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
meshselector = Ladybug_MeshThresholdSelector(inputMesh=heatmap.mesh, analysisResult=partition_list, operator=">=", levelOfPerform=Slider(50, range=0..100))  # -> out, totalValue, areaMeetsThresh, newColoredMesh, newMeshOutline; plug-in component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
pipe = Pipe(Curve=meshselector.newMeshOutline, Radius=Slider(0.01, range=0..0.1), Caps=0)

# ---- group: % of floor
area_5 = Area(Geometry=mesh)  # -> Area, Centroid
division_3 = Division(A=meshselector.areaMeetsThresh, B=area_5.Area)
multiplication_2 = Multiplication(A=division_3, B=100)
ghpython_script_3 = GhPythonScript(x=multiplication_2)  # -> a; same code as ghpython_script_2

# ---- group: Distance_height_Windows
lower_w_frame = Curve(list_item_3.Item)
plane_crv = Curve(project.Geometry)
grid_2 = Data(grid.point_2)
curve_middle_2 = CurveMiddle(Curve=lower_w_frame)
curve_middle_3 = CurveMiddle(Curve=plane_crv)
vector_2pt = Vector2Pt(PointA=curve_middle_2, PointB=curve_middle_3, Unitize=False)  # -> Vector, Length
deconstruct_2 = Deconstruct(Point=vector_2pt.Vector)  # -> XComponent, YComponent, ZComponent
larger_than = LargerThan(FirstNumber=deconstruct_2.ZComponent, SecondNumber=0)  # -> LargerThan, OrEqualTo
list_length_3 = ListLength(List=flatten(grid_2))
ghpython_script_4 = GhPythonScript(x=vector_2pt.Length, y=larger_than.OrEqualTo)  # -> a
# ---------- ghpython_script_4: Python ----------
if y:
    a = x
else:
    a = -x
# ---------- end ghpython_script_4 ----------
duplicate_data_2 = DuplicateData(Data=graft(ghpython_script_4), Number=list_length_3, Order=True)
partition_list_2 = PartitionList(List=flatten(duplicate_data_2), Size=list_length_3)

# ---- group: Orient_Windows
window_2 = Data(vizquick_2)
grid_3 = Data(grid.point_2)
area_6 = Area(Geometry=window_2)  # -> Area, Centroid
list_length_4 = ListLength(List=flatten(grid_3))
evaluate_surface = EvaluateSurface(Surface=window_2, Point=area_6.Centroid)  # -> Point, Normal, UDirection, VDirection, Frame
vector_xyz = VectorXYZ(XComponent=0, YComponent=Slider(1, range=0..1), ZComponent=0)  # -> Vector, Length
xy_plane = XYPlane(Origin=Point(0, 0, 0))
angle = Angle(VectorA=evaluate_surface.Normal, VectorB=vector_xyz.Vector, Plane=xy_plane)  # -> Angle, Reflex
degrees = Degrees(Radians=angle.Angle)
duplicate_data_3 = DuplicateData(Data=graft(degrees), Number=list_length_4, Order=True)
partition_list_3 = PartitionList(List=flatten(duplicate_data_3), Size=list_length_4)

# ----
mesh_2 = Mesh(heatmap.mesh)

lt_values = Data(number_slider_2)
list_length_5 = ListLength(List=flatten(grid_2))
duplicate_data_4 = DuplicateData(Data=graft(lt_values), Number=list_length_5, Order=True)
partition_list_4 = PartitionList(List=flatten(duplicate_data_4), Size=list_length_5)

# ---- group: Visualize_custom
bounds = Bounds(Numbers=partition_list)
deconstruct_domain = DeconstructDomain(Domain=bounds)  # -> Start, End
gradient = Gradient(
    LowerLimit=deconstruct_domain.End,
    UpperLimit=deconstruct_domain.Start,
    Parameter=partition_list,
    stops=[0: RGB(234, 38, 0), 0.25: RGB(234, 126, 0), 0.5: RGB(254, 244, 84), 0.75: RGB(173, 203, 249), 1: RGB(75, 107, 169)])

# ---- group: Ratio_Windows
window_3 = Data(vizquick_2)
grid_4 = Data(grid.point_2)
dimensions = Dimensions(Surface=window_3)  # -> UDimension, VDimension
list_length_6 = ListLength(List=flatten(grid_4))
division_4 = Division(A=dimensions.UDimension, B=dimensions.VDimension)
duplicate_data_5 = DuplicateData(Data=graft(division_4), Number=list_length_6, Order=True)
partition_list_5 = PartitionList(List=flatten(duplicate_data_5), Size=list_length_6)

# ----
mesh_spray = MeshSpray(Mesh=mesh, Points=orgin_pt_list, Colours=gradient, SprayMode=0)
mesh_spray_2 = MeshSpray(Mesh=mesh_custom, Points=orgin_pt_list, Colours=gradient, SprayMode=0)

text_tag = TextTag(Location=area_5.Centroid, Text=ghpython_script_3, Colour=ColourSwatch(SwatchColor=RGB(0, 0, 0)))
text_tag_2 = TextTag(Location=orgin_pt_list, Text=flatten(partition_list), Colour=ColourSwatch(SwatchColor=RGB(0, 0, 0)))
custom_preview_3 = CustomPreview(Geometry=pipe, Material=ColourSwatch(SwatchColor=RGB(0, 0, 0)))
custom_preview_4 = CustomPreview(Geometry=mesh_2, Material=ColourSwatch(SwatchColor=RGB(0, 0, 0)))

# ---- group: Calculate DA / Threshold
simplify_tree = SimplifyTree(Tree=replace_items, Front=False)
larger_than_2 = LargerThan(FirstNumber=simplify_tree, SecondNumber=Slider(300, range=0..1000))  # -> LargerThan, OrEqualTo

# ---- group: Calculate DA / OCC_Time
xdata_2 = LBDeconstructData(data=schtodata_2)  # -> header, values; plug-in component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
larger_than_3 = LargerThan(FirstNumber=xdata_2.values, SecondNumber=Slider(0, range=0..100))  # -> LargerThan, OrEqualTo

# ---- group: Calculate DA / Calculate threshiold time
gate_and = GateAnd(A=larger_than_3.LargerThan, B=larger_than_2.OrEqualTo)
cull_pattern = CullPattern(List=simplify_tree, CullPattern=gate_and)
list_length_7 = ListLength(List=cull_pattern)

# ---- group: Calculate DA / Calculate occ time
ghpython_script_5 = GhPythonScript(x=larger_than_3.LargerThan)  # -> a
# ---------- ghpython_script_5: Python ----------
if x:
    a = 1
else:
    a = 0
# ---------- end ghpython_script_5 ----------
mass_addition = MassAddition(Input=ghpython_script_5)  # -> Result, PartialResults

# ---- group: Calculate DA / DA
division_5 = Division(A=list_length_7, B=mass_addition.Result)
ghpython_script_6 = GhPythonScript(x=division_5)  # -> flatten(a)
# ---------- ghpython_script_6: Python ----------
a = round(x*100,0)
# ---------- end ghpython_script_6 ----------

# ---- group: Vizual
colrange_2 = LBColorRange(index=Slider(1, range=0..25))  # -> colors; plug-in component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
legendpar_2 = LBLegendParameters(min=Slider(0, range=0..100), max=Slider(100, range=0..100), colors=colrange_2)  # -> leg_par; plug-in component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
heatmap_2 = LBSpatialHeatmap(values=ghpython_script_6, mesh=mesh, legend_par=legendpar_2)  # -> mesh, legend, title, colors, legend_par; plug-in component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
meshselector_2 = Ladybug_MeshThresholdSelector(inputMesh=heatmap_2.mesh, operator=">=", levelOfPerform=Slider(50, range=0..100))  # -> out, totalValue, areaMeetsThresh, newColoredMesh, newMeshOutline; plug-in component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
pipe_2 = Pipe(Curve=meshselector_2.newMeshOutline, Radius=Slider(0.01, range=0..0.1), Caps=0)

# ---- group: % of floor
area_7 = Area(Geometry=mesh)  # -> Area, Centroid
division_6 = Division(A=meshselector_2.areaMeetsThresh, B=area_7.Area)
multiplication_3 = Multiplication(A=division_6, B=100)
ghpython_script_7 = GhPythonScript(x=multiplication_3)  # -> a; same code as ghpython_script_2

# ---- group: eksport av resutltater
filbane = Panel("C:\Users\tobia\Documents\Test\dagslys\Resultater.txt")
text_join = TextJoin(Text=replace_items, Join=", ")
exporter_data = GhPythonScript(data=text_join, filbane=filbane, kjør=Toggle(False))  # -> flatten(a)
# ---------- exporter_data: Python ----------
if kjør:
    
    f = open(filbane, "a")
    f.write(str(data) + "\n")
    f.close()
    a = "data eksportert"
# ---------- end exporter_data ----------

# ----
mesh_3 = Mesh(heatmap_2.mesh)
panel_14 = Panel(exporter_data)

custom_preview_5 = CustomPreview(Geometry=pipe_2, Material=ColourSwatch(SwatchColor=RGB(0, 0, 0)))
custom_preview_6 = CustomPreview(Material=ColourSwatch(SwatchColor=RGB(0, 0, 0)))
text_tag_3 = TextTag(Location=area_7.Centroid, Text=ghpython_script_7, Colour=ColourSwatch(SwatchColor=RGB(0, 0, 0)))
text_tag_4 = TextTag(Text=flatten(ghpython_script_6), Colour=ColourSwatch(SwatchColor=RGB(0, 0, 0)))

pt_2 = Data(grid.point_2)
window_4 = Data(vizquick_2)
deconstruct_brep_2 = DeconstructBrep(Brep=window_4)  # -> Faces, Edges, Vertices
list_length_8 = ListLength(List=pt_2)

# ----
# Variables
curve_middle_4 = CurveMiddle(Curve=deconstruct_brep_2.Edges)
deconstruct_3 = Deconstruct(Point=curve_middle_4)  # -> XComponent, YComponent, ZComponent
sort_list_2 = SortList(Keys=deconstruct_3.ZComponent, ValuesValuesA=deconstruct_brep_2.Edges)  # -> Keys, ValuesValuesA

list_item_4 = ListItem(List=sort_list_2.ValuesValuesA, Index=0, Wrap=True)  # -> Item, Item1, Item2, Item3

# ---- group: Vertical
number_slider_16 = Slider(0.1, range=0..0.1)
end_points = EndPoints(Curve=list_item_4.Item1)  # -> Start, End
divide_length = DivideLength(Curve=list_item_4.Item1, Length=number_slider_16)  # -> Points, Tangents, Parameters
divide_length_2 = DivideLength(Curve=list_item_4.Item2, Length=number_slider_16)  # -> Points, Tangents, Parameters
end_points_2 = EndPoints(Curve=list_item_4.Item2)  # -> Start, End
number_slider_17 = Slider(1, range=0..1)
weave = Weave(Pattern=[0, 1], Stream0=end_points_2.End, Stream1=divide_length_2.Points, NullGaps=False)
weave_2 = Weave(Pattern=[0, 1], Stream0=end_points.End, Stream1=divide_length.Points, NullGaps=False)
curve_middle_5 = CurveMiddle(Curve=list_item_4.Item3)
closest_points = ClosestPoints(Point=pt_2, Cloud=weave_2, Count=number_slider_17)  # -> ClosestPoint, CPIndex, Distance
closest_points_2 = ClosestPoints(Point=pt_2, Cloud=weave, Count=number_slider_17)  # -> ClosestPoint, CPIndex, Distance
partition_list_6 = PartitionList(List=flatten(closest_points.ClosestPoint), Size=list_length_8)
partition_list_7 = PartitionList(List=flatten(closest_points_2.ClosestPoint), Size=list_length_8)
vector_2pt_2 = Vector2Pt(PointA=pt_2, PointB=partition_list_7, Unitize=False)  # -> Vector, Length
vector_2pt_3 = Vector2Pt(PointA=pt_2, PointB=partition_list_6, Unitize=False)  # -> Vector, Length
angle_2 = Angle(VectorA=vector_2pt_3.Vector, VectorB=vector_2pt_2.Vector)  # -> Angle, Reflex
degrees_2 = Degrees(Radians=angle_2.Angle)
vector_display = VectorDisplay(Anchor=pt_2, Vector=vector_2pt_3.Vector)
vector_display_2 = VectorDisplay(Anchor=pt_2, Vector=vector_2pt_2.Vector)

# ---- group: Horisontal
number_slider_18 = Slider(0.1, range=0..0.1)
divide_length_3 = DivideLength(Curve=list_item_4.Item, Length=number_slider_18)  # -> Points, Tangents, Parameters
end_points_3 = EndPoints(Curve=list_item_4.Item3)  # -> Start, End
divide_length_4 = DivideLength(Curve=list_item_4.Item3, Length=number_slider_18)  # -> Points, Tangents, Parameters
end_points_4 = EndPoints(Curve=list_item_4.Item)  # -> Start, End
number_slider_19 = Slider(1, range=0..1)
weave_3 = Weave(Pattern=[0, 1], Stream0=end_points_3.End, Stream1=divide_length_4.Points, NullGaps=False)
weave_4 = Weave(Pattern=[0, 1], Stream0=end_points_4.End, Stream1=divide_length_3.Points, NullGaps=False)
closest_points_3 = ClosestPoints(Point=pt_2, Cloud=weave_4, Count=number_slider_19)  # -> ClosestPoint, CPIndex, Distance
curve_middle_6 = CurveMiddle(Curve=list_item_4.Item)
closest_points_4 = ClosestPoints(Point=pt_2, Cloud=weave_3, Count=number_slider_19)  # -> ClosestPoint, CPIndex, Distance
curve_middle_7 = CurveMiddle(Curve=list_item_4.Item2)
partition_list_8 = PartitionList(List=flatten(closest_points_3.ClosestPoint), Size=list_length_8)
partition_list_9 = PartitionList(List=flatten(closest_points_4.ClosestPoint), Size=list_length_8)
vector_2pt_4 = Vector2Pt(PointA=pt_2, PointB=partition_list_8, Unitize=False)  # -> Vector, Length
vector_2pt_5 = Vector2Pt(PointA=pt_2, PointB=partition_list_9, Unitize=False)  # -> Vector, Length
angle_3 = Angle(VectorA=vector_2pt_4.Vector, VectorB=vector_2pt_5.Vector)  # -> Angle, Reflex
degrees_3 = Degrees(Radians=angle_3.Angle)
vector_display_3 = VectorDisplay(Anchor=pt_2, Vector=vector_2pt_5.Vector)
vector_display_4 = VectorDisplay(Anchor=pt_2, Vector=vector_2pt_4.Vector)

# ---- group: Distance / Find closest point and distance
divide_length_5 = DivideLength(Curve=project.Geometry, Length=Slider(0.1, range=0..0.1))  # -> Points, Tangents, Parameters
end_points_5 = EndPoints(Curve=project.Geometry)  # -> Start, End
list_length_9 = ListLength(List=flatten(pt))

# ----
weave_5 = Weave(Pattern=[0, 1], Stream0=end_points_5.End, Stream1=divide_length_5.Points, NullGaps=False)

# ---- group: Distance / Find closest point and distance (continued)
closest_points_5 = ClosestPoints(Point=pt, Cloud=weave_5, Count=Slider(1, range=0..1))  # -> ClosestPoint, CPIndex, Distance
partition_list_10 = PartitionList(List=flatten(closest_points_5.Distance), Size=list_length_9)

# ---- group: Distance
partition_list_11 = PartitionList(List=flatten(closest_points_5.ClosestPoint), Size=list_length_9)
line = Line(StartPoint=pt, EndPoint=partition_list_11)

# ---- group: Factor
max_avstand_fra_vindu = Slider(6, range=0..10)
bounds_2 = Bounds(Numbers=flatten(partition_list_10))
deconstruct_domain_2 = DeconstructDomain(Domain=bounds_2)  # -> Start, End
construct_domain = ConstructDomain(DomainStart=Slider(0, range=0..100), DomainEnd=max_avstand_fra_vindu)
construct_domain_2 = ConstructDomain(DomainStart=Slider(1, range=0..1), DomainEnd=Slider(0, range=0..100))
remap_numbers = RemapNumbers(Value=partition_list_10, Source=construct_domain, Target=construct_domain_2)  # -> Mapped, Clipped
ghpython_script_8 = GhPythonScript(x=remap_numbers.Mapped)  # -> a
# ---------- ghpython_script_8: Python ----------
__author__ = "tobia"
__version__ = "2021.02.15"

import rhinoscriptsyntax as rs

if x > 0:
    a = x
else:
    a = 0
# ---------- end ghpython_script_8 ----------

# ---- group: Orientation_pt_to_Windows
pt_3 = Data(grid.point_2)
vector_xyz_2 = VectorXYZ(XComponent=0, YComponent=Slider(1, range=0..1), ZComponent=0)  # -> Vector, Length
xy_plane_2 = XYPlane(Origin=Point(0, 0, 0))

# ----
vector_2pt_6 = Vector2Pt(PointA=pt_3, PointB=partition_list_11, Unitize=False)  # -> Vector, Length

# ---- group: Orientation_pt_to_Windows (continued)
angle_4 = Angle(VectorA=vector_2pt_6.Vector, VectorB=vector_xyz_2.Vector, Plane=xy_plane_2)  # -> Angle, Reflex
degrees_4 = Degrees(Radians=angle_4.Angle)
vector_display_5 = VectorDisplay(Anchor=pt_3, Vector=vector_2pt_6.Vector)

# ---- group: collect
height_window = Data(partition_list_2)
horisontal = Data(degrees_3)
orientation = Data(partition_list_3)
lt_value = Data(partition_list_4)
retning = Data(degrees_4)
ratio = Data(partition_list_5)
vertical = Data(degrees_2)
panel_15 = Panel("""0
1
2
3
4
5
6""")
simplify_tree_2 = SimplifyTree(Tree=ratio, Front=False)
simplify_tree_3 = SimplifyTree(Tree=orientation, Front=False)
simplify_tree_4 = SimplifyTree(Tree=height_window, Front=False)
simplify_tree_5 = SimplifyTree(Tree=retning, Front=False)
simplify_tree_6 = SimplifyTree(Tree=horisontal, Front=False)
simplify_tree_7 = SimplifyTree(Tree=vertical, Front=False)
simplify_tree_8 = SimplifyTree(Tree=lt_value, Front=False)
weave_6 = Weave(
    Pattern=panel_15,
    Stream0=simplify_tree_8,
    Stream1=simplify_tree_6,
    Stream2=simplify_tree_7,
    Stream3=simplify_tree_5,
    Stream4=simplify_tree_2,
    Stream5=simplify_tree_3,
    Stream6=simplify_tree_4,
    NullGaps=False)

# ----
list_length_10 = ListLength(List=panel_15)
partition_list_12 = PartitionList(List=weave_6, Size=list_length_10)
panel_16 = Panel("""0
1
2
3""")
list_item_5 = ListItem(List=partition_list_12, Index=panel_16, Wrap=True)

# ---- group: eksport av variabler
filbane_2 = Panel("C:\Users\tobia\Documents\Test\dagslys\variabler.txt")
text_join_2 = TextJoin(Text=list_item_5, Join=", ")
exporter_data_2 = GhPythonScript(data=text_join_2, filbane=filbane_2, kjør=Toggle(False))  # -> a; same code as exporter_data

# ----
panel_17 = Panel(exporter_data_2)

# ==== cluster Grid: Grid for å definere klimaberegninger
offset = ClusterInput()
gulv = ClusterInput()
distance_floor = ClusterInput()
grid_size = ClusterInput()
distance_floor_2 = Data(distance_floor)
offset_2 = Data(offset)

# ---- group: Input
gulv_2 = Brep(gulv)

# ----
grid_size_2 = Data(grid_size)

# ---- group: Model_Setup
negative = Negative(Value=offset_2)
offset_curve = OffsetCurve(Curve=gulv_2, Distance=offset_2, Plane=PlaneXY(0, 0, 0), Corners=1)
brep = Brep(offset_curve)
unit_z = UnitZ(Factor=distance_floor_2)
dimensions = Dimensions(Surface=brep)  # -> UDimension, VDimension
move = Move(Geometry=brep, Motion=unit_z)  # -> Geometry, Transform
division = Division(A=dimensions.UDimension, B=grid_size_2)
division_2 = Division(A=dimensions.VDimension, B=grid_size_2)

# ----
ghpython_script = GhPythonScript(x=division_2)  # -> a
# ---------- ghpython_script: Python ----------
__author__ = "tobia"
__version__ = "2021.02.26"

import rhinoscriptsyntax as rs

if x < 1:
    a = 1
else:
    a = x
# ---------- end ghpython_script ----------
ghpython_script_2 = GhPythonScript(x=division)  # -> a; same code as ghpython_script

# ---- group: Generate_mesh
mesh_surface = MeshSurface(Surface=move.Geometry, UCount=ghpython_script_2, VCount=ghpython_script, Overhang=Toggle(True), Equalize=False)
face_normals = FaceNormals(Mesh=mesh_surface)  # -> Centers, Normals
list_item = ListItem(List=face_normals.Centers, Index=0, Wrap=True)  # -> Item, Item1
distance = Distance(PointA=list_item.Item, PointB=list_item.Item1)
actuall_size = Panel(distance)

# ---- group: Exclude_pt
point_in_curve = PointInCurve(Point=face_normals.Centers, Curve=move.Geometry)  # -> Relationship, Point
equality = Equality(FirstNumber=point_in_curve.Relationship, SecondNumber="0")  # -> Equality, Inequality
cull_faces = CullFaces(Mesh=mesh_surface, Pattern=equality.Equality)
face_normals_2 = FaceNormals(Mesh=cull_faces)  # -> Centers, Normals

# ---- group: Output
normals = Data(face_normals_2.Normals)
point = Point(face_normals_2.Centers)
mesh = Mesh(cull_faces)

# ----
point_2 = ClusterOutput(point)
mesh_2 = ClusterOutput(mesh)
normals_2 = ClusterOutput(normals)

# ==== cluster Sun_up: EN 17037:2018
lux_values = ClusterInput()  # Lux_values 8760
data = Data(lux_values)
list_length = ListLength(List=data)
series = Series(Start=Slider(1, range=0..100), Step=1, Count=list_length)
division = Division(A=list_length, B=2)
duplicate_data = DuplicateData(Data=Slider(0, range=0..1), Number=division, Order=True)
duplicate_data_2 = DuplicateData(Data=Slider(1, range=0..1), Number=division, Order=True)
sort_list = SortList(Keys=data, ValuesValuesA=series)  # -> reverse(Keys), ValuesValuesA
merge = Merge(Data1=duplicate_data, Data2=duplicate_data_2)
sort_list_2 = SortList(Keys=sort_list.ValuesValuesA, ValuesValuesA=merge)  # -> Keys, ValuesValuesA
data_2 = Data(sort_list_2.ValuesValuesA)
sun_up = ClusterOutput(data_2)  # Sun_up values acc. Daylight standard
